# Grasshopper definition Process Path Planning.gh (Grasshopper 1.0.7)

reload_process_from_disk = Button()
process_path = GhPythonScript()  # -> path
# ---------- process_path: Python ----------
from Rhino.RhinoDoc import ActiveDoc
import os
path = os.path.splitext(ActiveDoc.Path)[0] + "_process.json"
print path
# ---------- end process_path ----------
file_path = FilePath(process_path)
json_unpickle = GhPythonScript(path=file_path, enable=True, reload=reload_process_from_disk)  # -> warn_col, warn_msg, data; inputs enable: Boolean
# ---------- json_unpickle: Python ----------
import jsonpickle
import os
import datetime
if enable and not reload:
    exist = os.path.exists(path)
    if exist:
        with open(path, 'r') as f:
            data = jsonpickle.decode(f.read(), keys=True)
        c_time = datetime.datetime.fromtimestamp(os.path.getmtime(path))
        warn_col = "lime"
        warn_msg = "Process File loaded with %s Beams, %s Clamps, %s Grippers.\n File Modified on %s." % (len(list(data.assembly.beams())), len(list(data.clamps)), len(list(data.grippers)), c_time)
    else:
        warn_col = "orange"    
        warn_msg = "Process File not created yet"
# ---------- end json_unpickle ----------
legend = Legend(Colour=json_unpickle.warn_col, Tags=json_unpickle.warn_msg, LegendType=2)
process = Data(json_unpickle.data)

# ----
# Reload Python Modules (if Module Code is Changed)
python_module_to_reload = Panel("""compas
compas_fab
roslibpy
integral_timber_joints""")
# Development Tools
reload = Button()
py = PythonScript(reload_module_button=reload, module_names=python_module_to_reload)  # inputs module_names: list
# ---------- py: Python ----------
import compas_ghpython
from compas_ghpython import unload_modules
if reload_module_button:
    for module in module_names:
        unload_modules(module)
# ---------- end py ----------

# ----
# Check Path and Environment
compas_version = GhPythonScript()  # -> out, compas_version, compas_fab_version, compas_path, compas_fab_path, compas_env_name, python_directory
# ---------- compas_version: Python ----------
__author__ = "leungp"
__version__ = "2020.04.20"

import rhinoscriptsyntax as rs
import compas
import compas_fab
compas_version  = compas.__version__
compas_fab_version = compas_fab.__version__
import os
compas_path = os.path.abspath(compas.__file__)
compas_fab_path = os.path.abspath(compas_fab.__file__)

import compas_bootstrapper
compas_env_name = compas_bootstrapper.ENVIRONMENT_NAME
python_directory = compas_bootstrapper.PYTHON_DIRECTORY
# ---------- end compas_version ----------
compas_environment_name = Panel(compas_version.compas_env_name)
compas_version_2 = Panel(compas_version.compas_version)
compas_fab_version = Panel(compas_version.compas_fab_version)
compas_path = Panel(compas_version.compas_path)
compas_fab_path = Panel(compas_version.compas_fab_path)
python_directory = Panel(compas_version.python_directory)

# ----
# Planning group
panel = Panel("robot12_eaYZ")

# ----
# Robot
panel_2 = Panel("192.168.0.117")
units = ValueList({"m": 1, "cm": 100, "mm": 1000}, selected="mm")
restart = Button()
load = Button()
ros = PythonScript(ip=panel_2, restart=restart)  # -> out, ros_client
# ---------- ros: Python ----------
import sys
import time
import scriptcontext as sc

from compas_fab.backends import RosClient

from System import TimeSpan
from System.Threading import ManualResetEventSlim


key = 'rosclient_%s' % str(ghenv.Component.InstanceGuid)
previous_client = sc.sticky.get(key, None)
if previous_client:
    previous_client.terminate()

ros_client = RosClient(ip, 9090)
sc.sticky[key] = ros_client

waitLock = ManualResetEventSlim(False)

ros_client.on_ready(lambda: waitLock.Set())

if not waitLock.Wait(TimeSpan.FromSeconds(5)):
    raise Exception('Unable to connect to ROS')


print "ROS is connected:", ros_client.is_connected
# ---------- end ros ----------
robot = PythonScript(client=ros.ros_client, unit=units, load=load)  # -> robot; inputs load: Boolean
# ---------- robot: Python ----------
from compas_fab.ghpython import RobotArtist

robot = client.load_robot(load_geometry=True,
                          urdf_param_name='/robot_description',
                          srdf_param_name='/robot_description_semantic',
                          precision=None,
                          local_cache_directory=None)

robot.scale(unit)
robot.artist = RobotArtist(robot.model)

print robot.info()
# ---------- end robot ----------
robot_2 = Data(robot)

process_2 = Data(process)
panel_3 = Panel(ros.out)
beam_sequence_number = Slider(32, range=1..40)

# ----
# Select Beam to plan
process_3 = Data(process_2)
python = GhPythonScript(process=process_3)  # -> out, beam_ids, beam_seq_ids
# ---------- python: Python ----------
beam_ids = [b for b in process.assembly.sequence]
beam_seq_ids = ["S%i"%(i+1) for i in range(len(process.assembly.sequence))]
# ---------- end python ----------
item = ListItem(List=python.beam_ids, Index=expr("x-1", beam_sequence_number), Wrap=True)
item_2 = ListItem(List=python.beam_seq_ids, Index=expr("x-1", beam_sequence_number), Wrap=True)
sequence_number = Panel(item_2)
beam_id = Panel(item)

collision_mesh_attached_clamps = Mesh()
collision_mesh_already_built_beams = Mesh()
attached_mesh_beam_in_gripper = Mesh()
attached_mesh_gripper = Mesh()
attached_mesh_toolchangerwithipgsflange = Mesh()
collision_mesh_static = Mesh()
pln_starting_plane = Plane()
pln_ending_plane = Plane()

paths_to_be_planned = Panel("""'assembly_wcf_storage'		-> 'assembly_wcf_inclampapproach'
'assembly_wcf_inclampapproach' 	-> 'assembly_wcf_inclamp'
'assembly_wcf_inclamp'		-> 'assembly_wcf_final'
'assembly_wcf_final'		-> 'assembly_wcf_finalretract'
'assembly_wcf_finalretract'	-> 'assembly_wcf_storage'""")

# ----
# Starting Configuration
robot_11_pickup_config = Panel("""22739.007813
-0
-4900
0
-90
90
0
0
0""")
robot_12_pickup_config = Panel("""-4556.088379
-3555.848633
-1.396026
-22.834742
-30.711554
0.593881
57.335655
0.009398""")
python_script = PythonScript(robot11=robot_11_pickup_config, robot12=robot_12_pickup_config)  # -> c; inputs robot11: list, robot12: list
# ---------- python_script: Python ----------
from compas_fab.robots import Configuration
from math import radians as rad


start_full_configuration = Configuration(
    values = (
        robot11[0],
        robot11[1], robot11[2],
        rad(robot11[3]), rad(robot11[4]), rad(robot11[5]), rad(robot11[6]), rad(robot11[7]), rad(robot11[8]),
        robot12[0], robot12[1],
        rad(robot12[2]), rad(robot12[3]), rad(robot12[4]), rad(robot12[5]), rad(robot12[6]), rad(robot12[7]),
        38000,
        0, -4915,
        0, 0, 0, 0, 0, 0,
        -12237, -4915,
        0, 0, 0, 0, 0, 0
        ),
    types = (
        2,
        2, 2,
        0, 0, 0, 0, 0, 0,
        2, 2,
        0, 0, 0, 0, 0, 0,
        2,
        2, 2,
        0, 0, 0, 0, 0, 0,
        2, 2,
        0, 0, 0, 0, 0, 0
        ),
    joint_names = (
        'bridge1_joint_EA_X',
        'robot11_joint_EA_Y', 'robot11_joint_EA_Z',
        'robot11_joint_1', 'robot11_joint_2', 'robot11_joint_3', 'robot11_joint_4', 'robot11_joint_5', 'robot11_joint_6',
        'robot12_joint_EA_Y', 'robot12_joint_EA_Z',
        'robot12_joint_1', 'robot12_joint_2', 'robot12_joint_3', 'robot12_joint_4', 'robot12_joint_5', 'robot12_joint_6',
        'bridge2_joint_EA_X',
        'robot21_joint_EA_Y', 'robot21_joint_EA_Z',
        'robot21_joint_1', 'robot21_joint_2', 'robot21_joint_3', 'robot21_joint_4', 'robot21_joint_5', 'robot21_joint_6',
        'robot22_joint_EA_Y', 'robot22_joint_EA_Z',
        'robot22_joint_1', 'robot22_joint_2', 'robot22_joint_3', 'robot22_joint_4', 'robot22_joint_5', 'robot22_joint_6'
        )
    )

c = start_full_configuration
# ---------- end python_script ----------
pickup_frame_plane_read_from_wobj0_tool0 = Plane(Plane(origin=(23237.50586, 4567.052246, 935.100708), x=(-0.06596095582, -0.007370644881, 0.9977949819), y=(0.01603430264, -0.9998514313, -0.006325860542)))
configurations_at_pickup = Data(python_script)

# ----
# Beam Geometry - All Beams
swatch = ColourSwatch(SwatchColor=RGB(194, 194, 194))
all_beams = GhPythonScript(process=process_3, beam_color=swatch)  # -> beams; inputs beam_color: Color
# ---------- all_beams: Python ----------
__author__ = "leungp"
__version__ = "2020.02.19"

from compas_ghpython.helpers import mesh_draw
from compas.geometry import Transformation
from compas.datastructures import meshes_join

from Rhino.Geometry import Mesh as RhinoMesh
assembly = process.assembly

beams = []
for beam in process.assembly.beams():
    beams.append(mesh_draw(beam.cached_mesh, color = beam_color))
# ---------- end all_beams ----------
transform_design_to_robotworld = Transform({TransformCount=1, Name="Orientation", source.origin.x=-50, source.origin.y=850, source.origin.z=0, source.xaxis.x=0, source.xaxis.y=-1, source.xaxis.z=0, source.yaxis.x=1, source.yaxis.y=0, source.yaxis.z=0, target.origin.x=24991.934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})
transform = Transform(Geometry=all_beams, Transform=transform_design_to_robotworld)

# ----
# Get Geo and Frames
flange_pos_in_robworld = GhPythonScript(process=process_3, beam_id=item)  # -> out, assembly_wcf_inclampapproach, assembly_wcf_inclamp, assembly_wcf_final, assembly_wcf_finalretract
# ---------- flange_pos_in_robworld: Python ----------
from compas.geometry import Frame
from compas_ghpython import draw_frame

assembly = process.assembly
gripper_type = assembly.get_beam_attribute(beam_id, 'gripper_type')
gripper = process.get_one_gripper_by_type(gripper_type)

toolchanger = process.robot_toolchanger


def flange_frame_at(attribute_name):
    gripper_t0cp = process.get_gripper_t0cp_for_beam_at(beam_id, attribute_name)
    toolchanger.set_current_frame_from_tcp(gripper_t0cp)
    return toolchanger.current_frame.copy()

if process.get_gripper_t0cp_for_beam_at(beam_id, 'assembly_wcf_inclampapproach'):
    assembly_wcf_inclampapproach =  draw_frame(flange_frame_at('assembly_wcf_inclampapproach'))
assembly_wcf_inclamp =  draw_frame(flange_frame_at('assembly_wcf_inclamp'))
assembly_wcf_final =  draw_frame(flange_frame_at('assembly_wcf_final'))
assembly_wcf_finalretract =  draw_frame(flange_frame_at('assembly_wcf_finalretract'))
# ---------- end flange_pos_in_robworld ----------
visualize_beams = GhPythonScript(process=process_3, beam_id=item)  # -> out, previous_beams, current_beam_final, acm_origin_beam, acm_origin_tool_group, visual_origin_wrist, clamps_on_structure; inputs previous_beams_color: Color, current_beam_color: Color
# ---------- visualize_beams: Python ----------
__author__ = "leungp"
__version__ = "2020.02.19"

from compas_ghpython.helpers import mesh_draw
from compas.geometry import Transformation
from compas.datastructures import meshes_join

from Rhino.Geometry import Mesh as RhinoMesh
assembly = process.assembly

# If user has no selection, assume the last beam is picked.
if beam_id is None: beam_id = assembly.sequence[-1]

##########################
# Previous Beams
##########################

# Collect the previously-assembled beam(s)
previous_beams = []

for this_beam_id in assembly.get_already_built_beams(beam_id):
    beam = assembly.beam(this_beam_id)
    previous_beams.append(mesh_draw(beam.cached_mesh, color = previous_beams_color))

###################################
# Current Beam (Different Location)
###################################

# Select the current beam
beam = assembly.beam(beam_id)

# Translate the beam to various location and display
current_beam = []
current_beam_assembly_wcf_final = mesh_draw(beam.cached_mesh, color = current_beam_color)

def join_meshes(meshes):
    if len(meshes) == 1 : return meshes [0]
    

def beam_mesh_at(attribute_name):
    T = assembly.get_beam_transformaion_to(beam_id, attribute_name)
    if T is not None:
        return (mesh_draw(beam.cached_mesh.transformed(T), color = current_inclamp_color))
    else: return None

current_beam_storage = beam_mesh_at('assembly_wcf_storage')
current_beam_final = beam_mesh_at('assembly_wcf_final')
###################################
# Clamps (multiple clamps)
###################################

clamps_on_structure = []
# Visualize clamps
for neighbour_id in assembly.get_already_built_neighbors(beam_id):
    joint_id = (neighbour_id, beam_id)
    clamp_wcf_final = assembly.get_joint_attribute(joint_id, 'clamp_wcf_final')
    clamp_type = assembly.get_joint_attribute(joint_id, 'clamp_type')
    clamp = process.get_one_clamp_by_type(clamp_type).copy()
    clamp.current_frame = clamp_wcf_final
    clamp.clamp_jaw_position = 120
    clamp.gripper_jaw_position = 0
    clamps_on_structure += [mesh_draw(m) for m in clamp.draw_visuals()]
    print ("Clamps needed at " , joint_id, clamp.type_name)
    

###################################
# Gripper (At Origin for ACM)
###################################

from compas.geometry import Frame
# Tool changer (At Origin)
toolchanger = process.robot_toolchanger
toolchanger.current_frame = Frame.worldXY()
acm_origin_tool_group =  [mesh_draw(m) for m in toolchanger.draw_visuals()]

# Gripper (At Tool Changer)
gripper_type = assembly.get_beam_attribute(beam_id, 'gripper_type')
gripper = process.get_one_gripper_by_type(gripper_type)
gripper.current_frame = process.robot_toolchanger.tool_coordinate_frame.copy()
acm_origin_tool_group +=  [mesh_draw(m) for m in gripper.draw_visuals()]

# Beam (In Gripper)
gripper_t0cp = process.get_gripper_t0cp_for_beam_at(beam_id, 'assembly_wcf_final')
T = Transformation.from_frame_to_frame(gripper_t0cp, gripper.current_frame.copy())
acm_origin_beam = [mesh_draw(beam.cached_mesh.transformed(T))]

###################################
# Gripper (Different Location)
###################################

gripper = []
# Get Gripper and move it to the beam's frame
gripper_type = assembly.get_beam_attribute(beam_id, 'gripper_type')
_gripper = process.get_one_gripper_by_type(gripper_type)

#gripper_tcp_in_ocf = assembly.get_beam_attribute(beam_id, "gripper_tcp_in_ocf")
#gripper_tcp_in_wcf = gripper_tcp_in_ocf.transformed(Transformation.from_frame(beam.frame))

def draw_gripper_at(attribute_name, gripper_open = True):
    gripper_t0cp = process.get_gripper_t0cp_for_beam_at(beam_id, attribute_name)
    if gripper_t0cp is not None:
        _gripper.current_frame = gripper_t0cp
        if gripper_open: _gripper.open_gripper()
        else: _gripper.close_gripper()
        
        process.robot_toolchanger.set_current_frame_from_tcp(gripper_t0cp)

        meshes = meshes_join(_gripper.draw_visuals() + process.robot_toolchanger.draw_visuals())
        gripper.append(mesh_draw(meshes,  color = gripper_color))
        
    else: gripper.append(None)

visual_origin_wrist = mesh_draw(process.robot_wrist_collision_mesh)


#
#draw_beam_at('assembly_wcf_storage') # Beam does not go to 'assembly_wcf_storageapproach'
#draw_gripper_at('assembly_wcf_storageapproach', True)
#
#
#draw_beam_at('assembly_wcf_storage')
#draw_beam_at('assembly_wcf_storageretract')
#if assembly.get_beam_attribute(beam_id, 'assembly_wcf_inclampapproach') is not None:
#    draw_beam_at('assembly_wcf_inclampapproach')
#else:
#    draw_beam_at('assembly_wcf_inclamp')
#draw_beam_at('assembly_wcf_inclamp')
#draw_beam_at('assembly_wcf_final')
#draw_beam_at('assembly_wcf_final') # Beam does not go to 'assembly_wcf_finalretract'
#
#
#
#
#draw_gripper_at('assembly_wcf_storage', True)
#draw_gripper_at('assembly_wcf_storageretract', False)
#if assembly.get_beam_attribute(beam_id, 'assembly_wcf_inclampapproach') is not None:
#    draw_gripper_at('assembly_wcf_inclampapproach', False)
#else:
#    draw_gripper_at('assembly_wcf_inclamp', False)
#draw_gripper_at('assembly_wcf_inclamp', False)
#draw_gripper_at('assembly_wcf_final', False)
#draw_gripper_at('assembly_wcf_finalretract', True)
#
# ---------- end visualize_beams ----------

# ----
# Key Frames
design_to_robworld = DesignToRobWorld_2(G=flange_pos_in_robworld.assembly_wcf_inclampapproach)
design_to_robworld_2 = DesignToRobWorld_2(G=flange_pos_in_robworld.assembly_wcf_inclamp)
design_to_robworld_3 = DesignToRobWorld_2(G=flange_pos_in_robworld.assembly_wcf_final)
design_to_robworld_4 = DesignToRobWorld(G=flange_pos_in_robworld.assembly_wcf_finalretract)

# ----
# Attached Collision Mesh
unweld = UnweldMesh(Mesh=visualize_beams.acm_origin_beam, Angle=0.1)
attached_colision_mesh_at_origin_gripper = Geometry(visualize_beams.acm_origin_tool_group)  # "Attached Colision Mesh (at origin) - Gripper and Toolchanger"
attached_colision_mesh_at_origin_beam = Geometry(unweld)

# ----
# Static Collision - Clamps on Beam
transform_design_to_robotworld_2 = Transform({TransformCount=1, Name="Orientation", source.origin.x=-50, source.origin.y=850, source.origin.z=0, source.xaxis.x=0, source.xaxis.y=-1, source.xaxis.z=0, source.yaxis.x=1, source.yaxis.y=0, source.yaxis.z=0, target.origin.x=24991.934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})
transform_2 = Transform(Geometry=visualize_beams.clamps_on_structure, Transform=transform_design_to_robotworld_2)

# ----
# Visualization - Current Beam at final Pos
transform_design_to_robotworld_3 = Transform({TransformCount=1, Name="Orientation", source.origin.x=-50, source.origin.y=850, source.origin.z=0, source.xaxis.x=0, source.xaxis.y=-1, source.xaxis.z=0, source.yaxis.x=1, source.yaxis.y=0, source.yaxis.z=0, target.origin.x=24991.934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})
transform_3 = Transform(Geometry=visualize_beams.current_beam_final, Transform=transform_design_to_robotworld_3)

# ----
# Static Collision - Already Built Beams
transform_design_to_robotworld_4 = Transform({TransformCount=1, Name="Orientation", source.origin.x=-50, source.origin.y=850, source.origin.z=0, source.xaxis.x=0, source.xaxis.y=-1, source.xaxis.z=0, source.yaxis.x=1, source.yaxis.y=0, source.yaxis.z=0, target.origin.x=24991.934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})
transform_4 = Transform(Geometry=visualize_beams.previous_beams, Transform=transform_design_to_robotworld_4)

collision_mesh_scene_static = Mesh([<mesh referenced from the Rhino model> x26])

clear_previously_saved_trajectory = Button()
plan_motion = Button()

# ---- group: Beam + Tool + Wrist
merge = Merge(
    Data1=attached_colision_mesh_at_origin_beam,
    Data2=attached_colision_mesh_at_origin_gripper,
    Data3=visualize_beams.visual_origin_wrist)  # -> flatten(Result)
geo = Geometry(merge)
orient = Orient(Geometry=geo, Source=PlaneXY(0, 0, 0), Target=design_to_robworld)  # -> Geometry, Transform

# ----
preview = CustomPreview(Geometry=transform_3, Shader=ColourSwatch(SwatchColor=RGBA(50, 166, 0, 46)))
press_to_add_overwrite = Button()
press_to_add_overwrite_2 = Button()
merge_2 = Merge(Data1=collision_mesh_scene_static, Data2=transform_4, Data3=transform_2)
merge_3 = Merge(Data1=attached_colision_mesh_at_origin_beam, Data2=attached_colision_mesh_at_origin_gripper)

# ----
# Planning scene
# Pass collision objects to planning scene
# Attach an collision object
mesh = Mesh(merge_3)
panel_4 = Panel("Define an obstacle")
# This whole mess will be consolidated and improved
scene = PythonScript(robot=robot_2)  # -> scene
# ---------- scene: Python ----------
from scriptcontext import sticky as st

from compas_fab.robots import PlanningScene

# store scene in component
guid = str(ghenv.Component.InstanceGuid)
scene_key = "scene_" + guid

if scene_key not in st:
    st[scene_key] = None

if robot:
    st[scene_key] = PlanningScene(robot)

scene = st[scene_key]
# ---------- end scene ----------
mesh_2 = Mesh(flatten(merge_2))
mjoin = MeshJoin(Meshes=mesh)
mjoin_2 = MeshJoin(Meshes=mesh_2)
py_2 = PythonScript(robot=robot_2, group=panel)  # -> ee_link_name, preee_link_name
# ---------- py_2: Python ----------
if robot:
    ee_link_name = robot.get_end_effector_link_name(group)
    preee_link_name = robot.get_end_effector_link(group).parent_joint.parent.link
# ---------- end py_2 ----------
mesh_3 = PythonScript(mesh=mjoin)  # -> compas_mesh, acm
# ---------- mesh_3: Python ----------
from compas.datastructures import Mesh
from compas_rhino.geometry import RhinoMesh

compas_mesh = RhinoMesh.from_geometry(mesh).to_compas()
# ---------- end mesh_3 ----------
mesh_4 = PythonScript(mesh=mjoin_2)  # -> compas_mesh
# ---------- mesh_4: Python ----------
from compas.datastructures import Mesh
from compas_rhino.geometry import RhinoMesh

compas_mesh = RhinoMesh.from_guid(mesh).to_compas()
# ---------- end mesh_4 ----------
panel_5 = Panel(py_2.preee_link_name)
panel_6 = Panel(py_2.ee_link_name)
set_collision_mesh = PythonScript(scene=scene, compas_mesh=mesh_4, id="static_cm", set=press_to_add_overwrite_2)  # -> out
# ---------- set_collision_mesh: Python ----------
from compas_fab.robots import CollisionMesh

if scene and set:
    cm = CollisionMesh(compas_mesh, id)
    scene.add_collision_mesh(cm, True)
# ---------- end set_collision_mesh ----------
set_attached_cm = PythonScript(
    scene=scene,
    compas_mesh=mesh_3.compas_mesh,
    id="attached_cm",
    link_name=panel_6,
    touch_links=[panel_5, panel_6],
    set=press_to_add_overwrite)  # -> acm, out; inputs touch_links: list
# ---------- set_attached_cm: Python ----------
from compas_fab.robots import CollisionMesh
from compas_fab.robots import AttachedCollisionMesh
from compas.datastructures import Mesh

cm = CollisionMesh(compas_mesh, id)
acm = AttachedCollisionMesh(cm, link_name, touch_links)
    
if scene and set:
    scene.add_attached_collision_mesh(acm, True)
# ---------- end set_attached_cm ----------
panel_7 = Panel(set_collision_mesh)

# ----
# Plan motion
number_slider = Slider(1, range=1..360)
group = Data(panel)
python_2 = PythonScript(
    robot=robot_2,
    group=panel,
    goal_plane=design_to_robworld,
    tolerance_position=Slider(0.001, range=0..0.001),
    tolerance_xaxis_deg=Slider(1, range=1..360),
    tolerance_yaxis_deg=Slider(1, range=1..360),
    tolerance_zaxis_deg=number_slider)  # -> goal_constraints
# ---------- python_2: Python ----------
import math
from compas.geometry import Frame

frame = Frame(goal_plane.Origin, goal_plane.XAxis, goal_plane.YAxis)

tolerances_axes = [math.radians(tolerance_xaxis_deg), math.radians(tolerance_yaxis_deg), math.radians(tolerance_zaxis_deg)]

if robot:
    goal_constraints = robot.constraints_from_frame(frame, tolerance_position, tolerances_axes, group)
# ---------- end python_2 ----------
list = ValueList({"RRT", "RRT*": "RRTStar", "EST", "PRM": "RPM", "PRM*": "RPMStar", "SPARS"}, selected="RRT*")
plan_motion_2 = PythonScript(
    robot=robot_2,
    group=group,
    start_configuration=configurations_at_pickup,
    goal_constraints=python_2,
    planner_id=list,
    attached_collision_meshes=set_attached_cm.acm,
    compute=plan_motion,
    clear_prev_traj=clear_previously_saved_trajectory)  # -> out, trajectory; inputs goal_constraints: list, attached_collision_meshes: list
# ---------- plan_motion_2: Python ----------
"""Calculates a motion path.
    Inputs:
        robot: The robot
        group: str, optional
            The planning group used for calculation. Defaults to the robot's
            main planning group.
        start_configuration: :class:`compas_fab.robots.Configuration`, optional
            The robot's full configuration, i.e. values for all configurable
            joints of the entire robot cell, at the starting position. Defaults
            to the all-zero configuration.
        goal_constraints: list of :class:`compas_fab.robots.Constraint`
            The goal to be achieved, defined in a set of constraints.
            Constraints can be very specific, for example defining value domains
            for each joint, such that the goal configuration is included,
            or defining a volume in space, to which a specific robot link (e.g.
            the end-effector) is required to move to.
        planner_id: str
            The name of the algorithm used for path planning. Defaults to 'RRT'.
        attached_collision_meshes: list of :class:`compas_fab.robots.AttachedCollisionMesh`
            Defaults to None.
        compute: bool
            Press to calculate solution.
    Output:
        :class:`compas_fab.robots.JointTrajectory`
            The calculated trajectory.
"""
from __future__ import print_function
import logging
import scriptcontext as sc

guid = str(ghenv.Component.InstanceGuid)
response_key = "response_" + guid
if response_key not in sc.sticky:
    sc.sticky[response_key] = None

LOGGER = logging.getLogger('roslibpy')

if clear_prev_traj:
    sc.sticky[response_key] = None
    
if robot and robot.client and start_configuration and compute:
    if robot.client.is_connected:
        sc.sticky[response_key] = robot.plan_motion(goal_constraints,
                                                    start_configuration,
                                                    group,
                                                    options = {
                                                        'planner_id' : str(planner_id),
                                                        'attached_collision_meshes' : list(attached_collision_meshes),
                                                        'allowed_planning_time' : 20
                                                        }
                                                    )
    else:
        print("Robot client is not connected.")

trajectory = sc.sticky[response_key]
# ---------- end plan_motion_2 ----------
vis = PythonScript(response=plan_motion_2.trajectory)  # -> P, V, A, time
# ---------- vis: Python ----------
from compas_ghpython import list_to_ghtree

if response:

    positions = []
    velocities = []
    accelerations = []
    time_from_start = []

    for p in response.points:
        positions.append(p.positions)
        velocities.append(p.velocities)
        accelerations.append(p.accelerations)
        time_from_start.append(p.time_from_start.seconds)

    P = list_to_ghtree(list(zip(*positions)))
    V = list_to_ghtree(list(zip(*velocities)))
    A = list_to_ghtree(list(zip(*accelerations)))

    time = time_from_start[-1]
    print time
# ---------- end vis ----------
time_s = Panel(vis.time)
prismatic = QuickGraph(vis.P, SortOrder=0)
panel_8 = Panel("positions")
py_3 = PythonScript(robot=robot_2, group=group, trajectory=plan_motion_2.trajectory)  # -> configurations, full_configurations, fraction, time
# ---------- py_3: Python ----------
if trajectory:
    configurations = trajectory.points
    full_configurations = [robot.merge_group_with_full_configuration(c, trajectory.start_configuration, group) for c in configurations]
    start_configuration = trajectory.start_configuration
    fraction = trajectory.fraction
    time = trajectory.time_from_start
# ---------- end py_3 ----------
fraction = Panel(py_3.fraction)
time_s_2 = Panel(py_3.time)
panel_9 = Panel(plan_motion_2.out)
graph = QuickGraph(vis.V, SortOrder=0)
graph_2 = QuickGraph(vis.A, SortOrder=0)
idx = Slider(99, range=0..99)
panel_10 = Panel("velocities")
panel_11 = Panel("accelerations")
path = GhPythonScript(robot=robot_2, group=group, full_configurations=py_3.full_configurations)  # -> frames, P; inputs full_configurations: list
# ---------- path: Python ----------
import Rhino.Geometry as rg

frames = []

if robot:
    for c in full_configurations:
        if c:
            frame_WCF = robot.forward_kinematics(c, group, options = {'backend' : 'model'})
            frames.append(frame_WCF)

    P = [rg.Point3d(*list(frame.point)) for frame in frames]
# ---------- end path ----------
animate = PythonScript(robot=robot_2, group=group, configurations=py_3.full_configurations, idx=idx)  # -> configuration; inputs configurations: list, idx: Int32
# ---------- animate: Python ----------
import Grasshopper
from compas_fab.utilities import map_range
from compas_fab.robots import Configuration

count = len(configurations)

for i in range(ghenv.Component.Params.Input.Count):
    nslider = ghenv.Component.Params.Input[i].Sources[0]
    if nslider.GetType() == Grasshopper.Kernel.Special.GH_NumberSlider and nslider.NickName == 'idx':
        nslider.Slider.Maximum = max(count - 1, 1)
        nslider.Slider.Minimum = 0
        if nslider.Slider.Value > nslider.Slider.Maximum:
            nslider.Slider.Value = nslider.Slider.Maximum

if count and robot and configurations[0] != None:
    configuration = configurations[idx]
# ---------- end animate ----------
pline = PolyLine(Vertices=path.P, Closed=False)
preview_2 = CustomPreview(Geometry=[path.P, pline], Material=ColourSwatch(SwatchColor=RGB(59, 161, 95)))

# ----
# Visualize - Robot Planned Path
show_end_effector_frame = BooleanToggle(True)
show_base_frame = BooleanToggle(False)
show_collision = BooleanToggle(False)
show_frames = BooleanToggle(False)
show_visual = BooleanToggle(True)
show_acm = BooleanToggle(True)
show_tool = BooleanToggle(False)
visualize = PythonScript(
    robot=robot_2,
    acm=set_attached_cm.acm,
    group="robot12_eaYZ",
    configuration=animate,
    show_visual=show_visual,
    show_acm=show_acm,
    show_tool=show_tool,
    show_collision=show_collision)  # -> robot, visual, acm_mesh, collision, tool, frames, frames_color, planes, ee_frame; inputs tool_visualization: list of Mesh, show_tool: Boolean
# ---------- visualize: Python ----------
import Rhino.Geometry as rg
import ghpythonlib.components as ghcomp

from compas.geometry import Vector, Point
from compas_ghpython.utilities import draw_pipes
from compas_ghpython.utilities import draw_frame
from compas.geometry import Transformation, Scale

from ghpythonlib.components import Transform as gh_Transform

from System.Drawing import Color
from compas_ghpython import draw_frame
from compas_ghpython.helpers import mesh_draw

if robot and configuration:
    #print configuration
    frames = []
    
    robot.artist.update(configuration, visual=show_visual, collision=show_collision)
    
    if show_visual:
        visual = robot.artist.draw_visual()
    
    if show_tool:
        if robot.attached_tool:
            _ee_frame = robot.forward_kinematics(configuration, group=group)
            tool_T = rg.Transform.PlaneToPlane(rg.Plane.WorldXY, cFrame2rPlane(_ee_frame))
            tool = gh_Transform(tool_visualization, tool_T)
    
    if show_acm:
        _ee_frame = robot.forward_kinematics(configuration, group=group)
        _acm_mesh = acm.collision_mesh.mesh.transformed(Scale.from_factors([robot.scale_factor] * 3))
        _acm_mesh = _acm_mesh.transformed(Transformation.from_frame(_ee_frame))
        acm_mesh = mesh_draw(_acm_mesh)
        
    if show_collision:
        collision = robot.artist.draw_collision()


ee_frame = draw_frame( robot.forward_kinematics(configuration, group=group))
# ---------- end visualize ----------
preview_3 = CustomPreview(Geometry=visualize.visual, Shader=ColourSwatch(SwatchColor=RGBA(105, 105, 105, 0)))
preview_4 = CustomPreview(Geometry=visualize.acm_mesh, Shader=ColourSwatch(SwatchColor=RGBA(112, 112, 112, 218)))
preview_5 = CustomPreview(Geometry=visualize.collision, Shader=ColourSwatch(SwatchColor=RGBA(255, 0, 0, 200)))
preview_6 = CustomPreview(Geometry=visualize.tool, Shader=ColourSwatch(SwatchColor=RGB(66, 66, 66)))
preview_7 = CustomPreview(Geometry=visualize.frames, Shader=visualize.frames_color)

# ----
# Visualize - Attached CM
orient_2 = Orient(Geometry=mjoin, Source=PlaneXY(0, 0, 0), Target=visualize.ee_frame)  # -> Geometry, Transform
preview_8 = CustomPreview(Geometry=orient_2.Geometry, Shader=ColourSwatch(SwatchColor=RGBA(0, 255, 123, 200)))

# ==== cluster DesignToRobWorld
G = ClusterInput()
transform_design_to_robotworld = Transform({TransformCount=1, Name="Orientation", source.origin.x=-50, source.origin.y=850, source.origin.z=0, source.xaxis.x=0, source.xaxis.y=-1, source.xaxis.z=0, source.yaxis.x=1, source.yaxis.y=0, source.yaxis.z=0, target.origin.x=24991.934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})
transform = Transform(Geometry=G, Transform=transform_design_to_robotworld)
G_2 = ClusterOutput(transform)

# ==== cluster DesignToRobWorld_2
transform_design_to_robotworld = Transform({TransformCount=1, Name="Orientation", source.origin.x=-50, source.origin.y=850, source.origin.z=0, source.xaxis.x=0, source.xaxis.y=-1, source.xaxis.z=0, source.yaxis.x=1, source.yaxis.y=0, source.yaxis.z=0, target.origin.x=24991.934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})
G = ClusterInput()
transform = Transform(Geometry=G, Transform=transform_design_to_robotworld)
G_2 = ClusterOutput(transform)
